# Grasshopper definition Fuso.gh (Grasshopper 1.0.7)

comprimento_l = Slider(151, range=0..500)

# ---- group: Zona de Dosagem (ZD)
multiplication = Multiplication(A=comprimento_l, B="0.3")

# ---- group: Zona de Alimentação (ZA)
multiplication_2 = Multiplication(A=comprimento_l, B="0.3")

# ---- group: Zona de Compressão (ZC)
multiplication_3 = Multiplication(A=comprimento_l, B="0.4")

# ---- group: Diametro
l_20 = Panel("20")
# GNU nano 7.2                                    Fuso.md                                             | **Parte** | **Tamanho** | **Profundidade** |
# |---|---|---|
# | Comprimento (L) | 20xD | - |
# | Diametro (D) | L/20 | - |
# | Passo da Rosca (P) | P=D | - |
# | Zona de Aliemntação (ZA) | Lx0.3 | Dx0.12 |
# | Zona de Compressão (ZC) | Lx0.4 | |
# | Zona de Dosagem (ZD) | Lx0.3 | Dx(0.03 ~ 0.05) |
# | Angulo | 17º ~ 20º | - |
division = Division(A=comprimento_l, B=l_20)

# ----
paso_da_rosca_p = Data(division)
circle = Circle(Plane=PlaneXY(0, 0, 0), Radius=division)
unit_z = UnitZ(Factor=comprimento_l)
surface = Surface(circle)
extrude = Extrude(Base=surface, Direction=unit_z)  # -> flatten(Extrusion)

construct_domain = ConstructDomain(DomainStart="0.1", DomainEnd="0.85")
construct_domain_2 = ConstructDomain(DomainStart="0.2", DomainEnd="0.8")
construct_domain² = ConstructDomain²(DomainU=construct_domain_2, DomainV=construct_domain)
deconstruct_brep = DeconstructBrep(Brep=extrude)  # -> flatten(Faces), flatten(Edges), Vertices
list_item = ListItem(List=deconstruct_brep.Faces, Index="1", Wrap=True)
range = Range(Domain="0 to 1", Steps=expr("x-1", "4"))
range_2 = Range(Domain="0 to 1", Steps=expr("x-1", Slider(12, range=0..100)))
isotrim = Isotrim(Surface=reparameterize(list_item), Domain=construct_domain²)
cross_reference = CrossReference(ListA=range_2, ListB=range, CrossMode=1)  # -> ListA, ListB
construct_point = ConstructPoint(XCoordinate=cross_reference.ListA, YCoordinate=cross_reference.ListB, ZCoordinate=0)
evaluate_surface = EvaluateSurface(Surface=reparameterize(isotrim), Point=construct_point)  # -> Point, Normal, UDirection, VDirection, Frame
point_list = PointList(Points=evaluate_surface.Point)
